# Grasshopper definition Pouch.gh (Grasshopper 1.0.7)
# plug-ins: Kangaroo2 Components

radiusouter_num = Slider(10, range=0..20)
circlemeshsize = Slider(3, range=1..100)
radiusinner_num = Slider(2, range=0..20)
pressure = Slider(0.057, range=0..0.1)
initialinflation_num = Slider(0.2, range=0.2..1)
radiusmeshsize = Slider(50, range=0..100)
reset = Button()
on_off = BooleanToggle(True)
construct_point = ConstructPoint(XCoordinate=0, YCoordinate=0, ZCoordinate=0)
reset_bool = Boolean(reset)
onoff_bool = Boolean(on_off)
center_pt = Point(construct_point)
pressure_num = Number(pressure)
radiusmeshsize_num = Number(radiusmeshsize)
radiusinner_num_2 = Number(radiusinner_num)
circlemeshsize_num = Number(circlemeshsize)
radiusouter_num_2 = Number(radiusouter_num)
center_pt_2 = Point(center_pt)
initialinflation_num_2 = Number(initialinflation_num)
reset_bool_2 = Boolean(reset_bool)
onoff_bool_2 = Boolean(onoff_bool)
pressure_num_2 = Number(pressure_num)
radiusinner_num_3 = Number(radiusinner_num_2)
radiusouter_num_3 = Number(radiusouter_num_2)
initialinflation_num_3 = Number(initialinflation_num_2)
radiusmeshsize_num_2 = Number(radiusmeshsize_num)
circlemeshsize_num_2 = Number(circlemeshsize_num)
cluster = Cluster(
    center_pt=center_pt,
    radiusouter_num=radiusouter_num_2,
    radiusinner_num=radiusinner_num_2,
    initialinflation_num=initialinflation_num_2,
    radiusmeshsize_num=radiusmeshsize_num,
    circlemeshsize_num=circlemeshsize_num,
    pressure_num=pressure_num)  # -> connectors_points_2, mesh_1_2, mesh_2, goal_mesh_1, goal_mesh_2

reset_bool_3 = Boolean(reset_bool)
onoff_bool_3 = Boolean(onoff_bool)
bouncysolver = BouncySolver(
    GoalObjects=[cluster.goal_mesh_1, cluster.goal_mesh_2],
    Reset=reset_bool_3,
    Threshold=1e-08,
    Tolerance=0.01,
    Damping=0.99,
    Iterations=10,
    On=onoff_bool_3)  # -> I, V, O

list_length = ListLength(List=[cluster.goal_mesh_1, cluster.goal_mesh_2])  # -> flatten(Length)
partition_list = PartitionList(List=bouncysolver.O, Size=list_length)
explode_tree = ExplodeTree(Data=partition_list)  # -> Branch0, Branch1
mesh_join = MeshJoin(Meshes=explode_tree.Branch0)
unit_z = UnitZ(Factor=1)
face_normals = FaceNormals(Mesh=mesh_join)  # -> Centers, Normals
angle = Angle(VectorA=face_normals.Normals, VectorB=unit_z)  # -> Angle, Reflex
gradient = Gradient(
    LowerLimit="0",
    UpperLimit="3.2",
    Parameter=angle.Angle,
    stops=[0: RGB(0, 128, 0), 0.5: RGB(255, 255, 0), 1: RGB(255, 0, 0)])
custom_preview = CustomPreview(Geometry=mesh_join, Material=gradient)

# ==== cluster Cluster
radiusmeshsize_num = ClusterInput()
circlemeshsize_num = ClusterInput()
initialinflation_num = ClusterInput()
radiusouter_num = ClusterInput()
radiusinner_num = ClusterInput()
pressure_num = ClusterInput()
center_pt = ClusterInput()
radiusmeshsize_num_2 = Number(radiusmeshsize_num)
circlemeshsize_num_2 = Number(circlemeshsize_num)
initialinflation_num_2 = Number(initialinflation_num)
radiusouter_num_2 = Number(radiusouter_num)
radiusinner_num_2 = Number(radiusinner_num)
pressure_num_2 = Number(pressure_num)
center_pt_2 = Point(center_pt)
unit_z = UnitZ(Factor=initialinflation_num_2)
radiusouter_num_3 = Number(radiusouter_num_2)
radiusinner_num_3 = Number(radiusinner_num_2)
radiusinner_num_4 = Number(radiusinner_num_2)
radiusouter_num_4 = Number(radiusouter_num_2)
center_pt_3 = Point(center_pt_2)

radiusouter_num_5 = Number(radiusouter_num_2)
center_pt_4 = Point(center_pt_2)
circle_cnr = CircleCNR(Center=center_pt_4, Normal=Vector(0, 0, 1), Radius=radiusouter_num_5)

average = Average(Input=[radiusouter_num_4, radiusinner_num_4])
move = Move(Geometry=center_pt_3, Motion=unit_z)  # -> Geometry, Transform
expression = Expression(x=radiusouter_num_3, y=radiusinner_num_3, Expression="x-(x-y)/5")
center_pt_5 = Point(center_pt_2)

radiusinner_num_5 = Number(radiusinner_num_2)
circle_cnr_2 = CircleCNR(Center=center_pt_5, Normal=Vector(0, 0, 1), Radius=radiusinner_num_5)

circle = Circle(Plane=move.Geometry, Radius=expression)
circle_2 = Circle(Plane=move.Geometry, Radius=average)
innercircle_crv = Curve(circle_cnr_2)
outercircle_crv = Curve(circle_cnr)
innercircle_crv_2 = Curve(innercircle_crv)
outercircle_crv_2 = Curve(outercircle_crv)
loft = Loft(
    Curves=[circle, circle_cnr],
    Options={Adjust=False, Closed=False, LoftEnds=0, LoftSimp=0, LoftType=0, Rebuild=10, Refit=0.01})
loft_2 = Loft(
    Curves=[circle_cnr_2, circle_2, circle],
    Options={Adjust=False, Closed=False, LoftEnds=0, LoftSimp=0, LoftType=0, Rebuild=10, Refit=0.01})
outercircle_crv_3 = Curve(outercircle_crv)
circlemeshsize_num_3 = Number(circlemeshsize_num_2)
radiusmeshsize_num_3 = Number(radiusmeshsize_num_2)
radiusmeshsize_num_4 = Number(radiusmeshsize_num_2)
circlemeshsize_num_4 = Number(circlemeshsize_num_2)
divide_curve = DivideCurve(Curve=outercircle_crv_3, Count=8, Kinks=False)  # -> Points, Tangents, Parameters
mesh_surface = MeshSurface(Surface=loft_2, UCount=circlemeshsize_num_3, VCount=radiusmeshsize_num_3, Overhang=False, Equalize=False)
mesh_surface_2 = MeshSurface(Surface=loft, UCount=circlemeshsize_num_4, VCount=expr("x*2", radiusmeshsize_num_4), Overhang=False, Equalize=False)
connectors_points = Point(divide_curve.Points)
mesh_join = MeshJoin(Meshes=[mesh_surface, mesh_surface_2])
mesh_1 = Mesh(mesh_join)

center_pt_6 = Point(center_pt_4)
xy_plane = XYPlane(Origin=center_pt_6)
mirror = Mirror(Geometry=mesh_1, Plane=xy_plane)  # -> Geometry, Transform

pressure_num_3 = Number(pressure_num_2)
pressure = Pressure(M=mirror.Geometry, Strength=pressure_num_3)

nakedvertices = NakedVertices(Mesh=mirror.Geometry)  # -> ClothedIndex, NakedIndex, ClothedPts, NakedPts
edgelengths = EdgeLengths(Mesh=mirror.Geometry, LengthFactor=1, Strength=100)

pressure_num_4 = Number(pressure_num_2)
pressure_2 = Pressure(M=mesh_1, Strength=pressure_num_4)

show = Show(G=mirror.Geometry)
nakedvertices_2 = NakedVertices(Mesh=mesh_1)  # -> ClothedIndex, NakedIndex, ClothedPts, NakedPts
edgelengths_2 = EdgeLengths(Mesh=mesh_1, LengthFactor=1, Strength=100)
show_2 = Show(G=mesh_1)

outercircle_crv_4 = Curve(outercircle_crv)
innercircle_crv_3 = Curve(innercircle_crv)
point_in_curve = PointInCurve(Point=nakedvertices.NakedPts, Curve=outercircle_crv_4)  # -> Relationship, Point
point_in_curve_2 = PointInCurve(Point=nakedvertices.NakedPts, Curve=innercircle_crv_3)  # -> Relationship, Point
equality = Equality(FirstNumber=point_in_curve.Relationship, SecondNumber=1)  # -> Equality, Inequality
equality_2 = Equality(FirstNumber=point_in_curve_2.Relationship, SecondNumber=1)  # -> Equality, Inequality
cull_pattern = CullPattern(List=point_in_curve_2.Point, CullPattern=equality_2.Equality)
cull_pattern_2 = CullPattern(List=point_in_curve.Point, CullPattern=equality.Equality)
point = Point([cull_pattern_2, cull_pattern])

outercircle_crv_5 = Curve(outercircle_crv)
innercircle_crv_4 = Curve(innercircle_crv)
point_in_curve_3 = PointInCurve(Point=nakedvertices_2.NakedPts, Curve=outercircle_crv_5)  # -> Relationship, Point
point_in_curve_4 = PointInCurve(Point=nakedvertices_2.NakedPts, Curve=innercircle_crv_4)  # -> Relationship, Point
equality_3 = Equality(FirstNumber=point_in_curve_3.Relationship, SecondNumber=1)  # -> Equality, Inequality
equality_4 = Equality(FirstNumber=point_in_curve_4.Relationship, SecondNumber=1)  # -> Equality, Inequality
cull_pattern_3 = CullPattern(List=point_in_curve_4.Point, CullPattern=equality_4.Equality)
cull_pattern_4 = CullPattern(List=point_in_curve_3.Point, CullPattern=equality_3.Equality)
point_2 = Point([cull_pattern_4, cull_pattern_3])

center_pt_7 = Point(center_pt_4)
onplane = OnPlane(Points=point_2, Plane=center_pt_7, Strength=100)

center_pt_8 = Point(center_pt_4)
onplane_2 = OnPlane(Points=point, Plane=center_pt_8, Strength=100)

merge = Merge(Data1=show_2, Data2=[onplane, pressure_2, edgelengths_2])
merge_2 = Merge(Data1=show, Data2=[edgelengths, onplane_2, pressure])
connectors_points_2 = ClusterOutput(connectors_points)
goal_mesh_1 = ClusterOutput(merge)
goal_mesh_2 = ClusterOutput(merge_2)
mesh_1_2 = ClusterOutput(mesh_1)
mesh_2 = ClusterOutput(mirror.Geometry)
