# Grasshopper definition SFWB.gh (Grasshopper 1.0.7)
# plug-ins: Kangaroo2 Components

vertical_load = Slider(0, range=-20..20)
split_fold_angle = Slider(10, range=0.1..20)
foldingstrength_num = Slider(1, range=1..100)
n_num = Slider(8, range=3..20)
radius = Slider(10, range=5..15)
valleyfoldingstrength_num = Slider(1, range=0..100)
xy_plane = XYPlane(Origin=Point(0, 0, 0))
construct_point = ConstructPoint(XCoordinate=0, YCoordinate=0, ZCoordinate=0)
on_off_solver = BooleanToggle(True)

# ---- group: Pouch
radiusouter_num = Slider(10, range=0..20)
circlemeshsize = Slider(5, range=1..100)
radiusinner_num = Slider(2, range=0..20)
pressure = Slider(0.057, range=0..0.1)
initialinflation_num = Slider(0.2, range=0.2..1)
radiusmeshsize = Slider(100, range=0..100)
pressure_num = Number(pressure)
radiusmeshsize_num = Number(radiusmeshsize)
radiusouter_num_2 = Number(radiusouter_num)
radiusinner_num_2 = Number(radiusinner_num)
circlemeshsize_num = Number(circlemeshsize)
initialinflation_num_2 = Number(initialinflation_num)
pressure_num_2 = Number(pressure_num)
radiusinner_num_3 = Number(radiusinner_num_2)
radiusouter_num_3 = Number(radiusouter_num_2)
initialinflation_num_3 = Number(initialinflation_num_2)
radiusmeshsize_num_2 = Number(radiusmeshsize_num)
circlemeshsize_num_2 = Number(circlemeshsize_num)

# ---- group: theta
theta_topangle_deg = Slider(75, range=0.1..180)
theta_topangle_deg_2 = Number(theta_topangle_deg)
theta_topangle_deg_3 = Number(theta_topangle_deg_2)

# ----
reset = Button()
connectors_num = Slider(8, range=3..8)
b_splitfoldangle_deg = Slider(10, range=0..20)
mountain_col = Colour(ColourSwatch(SwatchColor=RGB(255, 0, 0)))
on_off_bool = Boolean(on_off_solver)
reset_bool = Boolean(reset)
negative = Negative(Value=vertical_load)
radius_num = Number(radius)
ground_pln = Plane(xy_plane)
n_num_2 = Integer(n_num)
valley_col = Colour(ColourSwatch(SwatchColor=RGB(31, 2, 250)))
center_pt = Point(construct_point)
splitfoldangle_num = Number(split_fold_angle)
foldingstrength_num_2 = Number(foldingstrength_num)
connectors_num_2 = Number(connectors_num)
mountain_col_2 = Colour(mountain_col)
radius_num_2 = Number(radius_num)
ground_pln_2 = Plane(ground_pln)
n_num_3 = Integer(n_num)
valley_col_2 = Colour(valley_col)
on_off_bool_2 = Boolean(on_off_bool)
center_pt_2 = Point(center_pt)
valleyfoldingstrength_num_2 = Number(valleyfoldingstrength_num)
reset_bool_2 = Boolean(reset_bool)
b_splitfoldangle_deg_2 = Number(b_splitfoldangle_deg)
verticalload_num = Number(negative)
splitfoldangle_num_2 = Number(splitfoldangle_num)
foldingstrength_num_3 = Number(foldingstrength_num_2)
connectors_num_3 = Number(connectors_num_2)
b_splitfoldangle_deg_3 = Number(b_splitfoldangle_deg_2)
verticalload_num_2 = Number(verticalload_num)
valleyfoldingstrength_num_3 = Number(valleyfoldingstrength_num_2)

# ---- group: Geometry of SFWB / Original Circle
radius_num_3 = Number(radius_num)
ground_pln_3 = Plane(ground_pln)
circle = Circle(Plane=ground_pln_3, Radius=radius_num_3)

# ---- group: Form and Angle Calculation
splitfoldangle_num_3 = Number(b_splitfoldangle_deg_2)
n_num_4 = Integer(n_num)
expression = Expression(n=n_num_4, b=splitfoldangle_num_3, Expression="(180 - n*b)/n")
alpha_facetangle_deg = Number(expression)
alpha_facetangle_deg_2 = Number(alpha_facetangle_deg)

n_num_5 = Integer(n_num)
expression_2 = Expression(n=n_num_5, Expression="360/n")
beta_adjacentangle_deg = Number(expression_2)
beta_adjacentangle_deg_2 = Number(beta_adjacentangle_deg)

# ---- group: Form and Angle Calculation / Eq. 13, 14, 15
beta_adjacentangle_deg_3 = Number(beta_adjacentangle_deg)
b_splitfoldangle_deg_4 = Number(b_splitfoldangle_deg_2)
theta_topangle_deg_4 = Number(theta_topangle_deg_2)
equation = GhPythonScript(theta=theta_topangle_deg_4, beta=beta_adjacentangle_deg_3, b=b_splitfoldangle_deg_4)  # -> d, xi, f
# ---------- equation: Python ----------
"""Provides a scripting component.
    Program based on Variables Associated With Valley Fold Angles (gamma_v)
    from the paper: Hanna, Brandon H., Spencer P. Magleby, Robert J. Lang, and Larry L. Howell. 2015. 
    “Force–Deflection Modeling for Generalized Origami Waterbomb-Base Mechanisms.” 
    Journal of Applied Mechanics 82 (8): 081001.
    Inputs:
        theta: The x script variable
        beta: The y script variable
        b: b
    Output:
        d: The a output variable
        xi: the xi output
        f: f """

__author__ = "tatung"

import rhinoscriptsyntax as rs
import math as math

theta = math.radians(theta)
beta = math.radians(beta)
b = math.radians(b)

d = math.cos(theta)**2 + math.cos(beta) * (math.sin(theta)**2)
d = math.acos(d)

xi = math.tan(d/2)/math.tan(theta)
xi = math.acos(xi)

f  = math.cos(d)*(math.cos(b/2)**2) + math.sin(b)*math.sin(d)*math.sin(xi)
f += ((math.cos(xi)**2) - math.cos(d) * (math.sin(xi)**2)) * (math.sin(b/2)**2)
f = math.acos(f)

d = math.degrees(d)
xi = math.degrees(xi)
f = math.degrees(f)
# ---------- end equation ----------
d_valleyfoldedadjacentangle_deg = Number(equation.d)
xi_deg = Number(equation.xi)
f_deg = Number(equation.f)
d_valleyfoldedadjacentangle_deg_2 = Number(d_valleyfoldedadjacentangle_deg)
xi_deg_2 = Number(xi_deg)
f_deg_2 = Number(f_deg)

# ---- group: Form and Angle Calculation / Calculate mountain fold angle gamma_m
alpha_facetangle_deg_3 = Number(alpha_facetangle_deg)
b_splitfoldangle_deg_5 = Number(b_splitfoldangle_deg_2)
f_deg_3 = Number(f_deg)
ghpython_script = GhPythonScript(alpha=alpha_facetangle_deg_3, b=b_splitfoldangle_deg_5, f=f_deg_3)  # -> gamma_m
# ---------- ghpython_script: Python ----------
"""Provides a scripting component.
    Inputs:
        alpha: The x script variable
        b: The y script variable
        f:
            
    Output:
        gamma_m: The a output variable"""

__author__ = "tatung"

import rhinoscriptsyntax as rs
import math as math

def s(x):
    return math.sin(x)
def c(x):
    return math.cos(x)
def t(x):
    return math.tan(x)
def ct(x):
    return 1/math.tan(x)
def cc(x):
    return 1/math.sin(x)
def sc(x):
    return 1/math.cos(x)
    
alpha = math.radians(alpha)
b = math.radians(b)
f = math.radians(f)

gamma_m = -math.acos(cc(alpha)*sc(b/2)*s(f/2) - ct(alpha)*t(b/2))
gamma_m = math.degrees(gamma_m)
# ---------- end ghpython_script ----------
negative_2 = Negative(Value=ghpython_script)
foldangle_int = Integer(negative_2)
foldangle_int_2 = Integer(foldangle_int)

# ---- group: Form and Angle Calculation / Calculate valley fold angle gamma_v
d_valleyfoldedadjacentangle_deg_3 = Number(d_valleyfoldedadjacentangle_deg)
b_splitfoldangle_deg_6 = Number(b_splitfoldangle_deg_2)
alpha_facetangle_deg_4 = Number(alpha_facetangle_deg)
theta_topangle_deg_5 = Number(theta_topangle_deg_2)
f_deg_4 = Number(f_deg)
xi_deg_3 = Number(xi_deg)
ghpython_script_2 = GhPythonScript(
    f=f_deg_4,
    d=d_valleyfoldedadjacentangle_deg_3,
    b=b_splitfoldangle_deg_6,
    theta=theta_topangle_deg_5,
    xi=xi_deg_3,
    alpha=alpha_facetangle_deg_4)  # -> gamma_v
# ---------- ghpython_script_2: Python ----------
"""Provides a scripting component.
    Program based on Variables Associated With Valley Fold Angles (gamma_v)
    from the paper: Hanna, Brandon H., Spencer P. Magleby, Robert J. Lang, and Larry L. Howell. 2015. 
    “Force–Deflection Modeling for Generalized Origami Waterbomb-Base Mechanisms.” 
    Journal of Applied Mechanics 82 (8): 081001.
    
    Inputs:
        f: The f script variable
        d: The d script variable
        b: b
        theta: theta
        xi: xi
        alpha: alpha
        
    Output:
        gamm_v: The a output variable"""

__author__ = "tatung"

import rhinoscriptsyntax as rs
import math as math

f = math.radians(f)
d = math.radians(d)
b = math.radians(b)
theta = math.radians(theta)
print(theta)
xi = math.radians(xi)
alpha = math.radians(alpha)

def s(x):
    return math.sin(x)
def c(x):
    return math.cos(x)
def t(x):
    return math.tan(x)
def ct(x):
    return 1/math.tan(x)
def cc(x):
    return 1/math.sin(x)
def sc(x):
    return 1/math.cos(x)

k6 = s(d)*s(f)
k5 = s(d)*s(f)*c(b/2)
k4 = c(d)*s(f)*s(b/2)
k3 = s(d)*c(f)*s(b/2)
k2 = c(b/2)
k1 = c(d)*c(f)*c(b/2)

if theta <= math.pi/2:
    h3 = c(xi)*k6
else:
    h3 = -c(xi)*k6
    
h2 = -k4 + s(xi)*k5
h1 = k1 - k2 + s(xi)*k3

phi = cc(alpha)*sc(f/2)*s(b/2)-ct(alpha)*t(f/2)
phi = math.pi - math.acos(phi)

eta = -h3 + math.sqrt(h3**2 - h1**2 + h2**2)
eta = eta/(h1 - h2)
eta = 2*math.atan(eta)

if theta <= math.pi/2:
    gamma_v = phi - eta
else:
    gamma_v = phi + eta
    
gamma_v = math.degrees(gamma_v)
# ---------- end ghpython_script_2 ----------
valleyfoldingangle = Number(ghpython_script_2)
valleyfoldingangle_2 = Number(valleyfoldingangle)

# ---- group: Geometry of SFWB / Original Mountain Points
n_num_6 = Integer(n_num)
divide_curve = DivideCurve(Curve=circle, Count=n_num_6, Kinks=False)  # -> flatten(Points), Tangents, Parameters

# ---- group: Geometry of SFWB / Original Valley Points
pi = Pi(Factor=1)
n_num_7 = Integer(n_num)
division = Division(A=pi, B=n_num_7)
rotate = Rotate(Geometry=divide_curve.Points, Angle=division, Plane=PlaneXY(0, 0, 0))  # -> flatten(Geometry), Transform

# ---- group: Geometry of SFWB / Mountain Points
splitfoldangle_num_4 = Number(splitfoldangle_num)
cluster = Cluster(geometry=divide_curve.Points, degrees=splitfoldangle_num_4)  # -> geometry1, geometry_2
mountainpoint1_pt = Point(cluster.geometry1)
mountainpoint2_pt = Point(cluster.geometry_2)
mountainpoint1_pt_2 = Point(mountainpoint1_pt)
mountainpoint2_pt_2 = Point(mountainpoint2_pt)

# ---- group: Geometry of SFWB / Valley Points
splitfoldangle_num_5 = Number(splitfoldangle_num)
cluster_2 = Cluster(geometry=rotate.Geometry, degrees=splitfoldangle_num_5)  # -> geometry1, geometry_2
valleypoint1_pt = Point(cluster_2.geometry1)
valleypoint2_pt = Point(cluster_2.geometry_2)
valleypoint1_pt_2 = Point(valleypoint1_pt)
valleypoint2_pt_2 = Point(valleypoint2_pt)

# ---- group: Geometry of SFWB / Mountain Folds
mountainpoint2_pt_3 = Point(mountainpoint2_pt)
mountainpoint1_pt_3 = Point(mountainpoint1_pt)
center_pt_3 = Point(center_pt)
line = Line(StartPoint=center_pt_3, EndPoint=[mountainpoint1_pt_3, mountainpoint2_pt_3])
mountainfolds_ln = Line(line)
mountainfolds_ln_2 = Line(mountainfolds_ln)

# ---- group: Geometry of SFWB / Valley Folds
valleypoint2_pt_3 = Point(valleypoint2_pt)
valleypoint1_pt_3 = Point(valleypoint1_pt)
center_pt_4 = Point(center_pt)
line_2 = Line(StartPoint=center_pt_4, EndPoint=[valleypoint1_pt_3, valleypoint2_pt_3])
valleyfolds_ln = Line(line_2)
valleyfolds_ln_2 = Line(valleyfolds_ln)

# ---- group: Geometry of SFWB / SFWB Mesh
mountainpoint1_pt_4 = Point(mountainpoint1_pt)
mountainpoint2_pt_4 = Point(mountainpoint2_pt)
valleypoint1_pt_4 = Point(valleypoint1_pt)
valleypoint2_pt_4 = Point(valleypoint2_pt)
center_pt_5 = Point(center_pt)
delaunay_mesh = DelaunayMesh(
    Points=[center_pt_5, mountainpoint1_pt_4, mountainpoint2_pt_4, valleypoint1_pt_4, valleypoint2_pt_4],
    Plane=PlaneXY(0, 0, 0))
sfwb_mesh = Mesh(delaunay_mesh)
sfwb_mesh_2 = Mesh(sfwb_mesh)

# ----
on_off_pouch = BooleanToggle(False)

# ---- group: Kangaroo Goals / Mountain Fold - Second
valleypoint1_pt_5 = Point(valleypoint1_pt)
shift_list = ShiftList(List=valleypoint1_pt_5, Shift=-1, Wrap=True)
foldangle_int_3 = Integer(foldangle_int)
radians = Radians(Degrees=foldangle_int_3)
foldingstrength_num_4 = Number(foldingstrength_num_2)
mountainpoint2_pt_5 = Point(mountainpoint2_pt)
mountainpoint1_pt_5 = Point(mountainpoint1_pt)
center_pt_6 = Point(center_pt)
hinge = Hinge(
    FoldStart=center_pt_6,
    FoldEnd=mountainpoint2_pt_5,
    Tip1=mountainpoint1_pt_5,
    Tip2=shift_list,
    RestAngle=radians,
    Strength=foldingstrength_num_4)

# ---- group: Kangaroo Goals / Mountain Fold - First
foldangle_int_4 = Integer(foldangle_int)
negative_3 = Negative(Value=foldangle_int_4)
foldingstrength_num_5 = Number(foldingstrength_num_2)
mountainpoint2_pt_6 = Point(mountainpoint2_pt)
mountainpoint1_pt_6 = Point(mountainpoint1_pt)
valleypoint2_pt_5 = Point(valleypoint2_pt)
radians_2 = Radians(Degrees=negative_3)
center_pt_7 = Point(center_pt)
hinge_2 = Hinge(
    FoldStart=center_pt_7,
    FoldEnd=mountainpoint1_pt_6,
    Tip1=mountainpoint2_pt_6,
    Tip2=valleypoint2_pt_5,
    RestAngle=radians_2,
    Strength=foldingstrength_num_5)

# ---- group: Kangaroo Goals / Valley Fold - First
valleyfoldingangle_3 = Number(valleyfoldingangle)
mountainpoint2_pt_7 = Point(mountainpoint2_pt)
shift_list_2 = ShiftList(List=mountainpoint2_pt_7, Shift=1, Wrap=True)
valleyfoldingstrength_num_4 = Number(valleyfoldingstrength_num_2)
radians_3 = Radians(Degrees=valleyfoldingangle_3)
valleypoint2_pt_6 = Point(valleypoint2_pt)
valleypoint1_pt_6 = Point(valleypoint1_pt)
center_pt_8 = Point(center_pt)
hinge_3 = Hinge(
    FoldStart=center_pt_8,
    FoldEnd=valleypoint1_pt_6,
    Tip1=valleypoint2_pt_6,
    Tip2=shift_list_2,
    RestAngle=radians_3,
    Strength=valleyfoldingstrength_num_4)

# ---- group: Kangaroo Goals / Stick To Ground Plane
mountainpoint2_pt_8 = Point(mountainpoint2_pt)
mountainpoint1_pt_7 = Point(mountainpoint1_pt)
valleypoint2_pt_7 = Point(valleypoint2_pt)
valleypoint1_pt_7 = Point(valleypoint1_pt)
stream_filter = StreamFilter(Gate=Toggle(True), Stream0=[mountainpoint1_pt_7, mountainpoint2_pt_8], Stream1=[valleypoint1_pt_7, valleypoint2_pt_7])
ground_pln_4 = Plane(ground_pln)
onplane = OnPlane(Points=stream_filter, Plane=ground_pln_4, Strength=100)

# ---- group: Kangaroo Goals / Vertical Load
unit_z = UnitZ(Factor=1)
verticalload_num_3 = Number(verticalload_num)
center_pt_9 = Point(center_pt)
load = Load(Point=center_pt_9, ForceVector=unit_z, Weighting=verticalload_num_3)

# ----
mountainpoint1_pt_8 = Point(mountainpoint1_pt)
valleypoint2_pt_8 = Point(valleypoint2_pt)
valleypoint1_pt_8 = Point(valleypoint1_pt)

# ---- group: Kangaroo Goals / Valley Fold - Second
valleyfoldingangle_4 = Number(valleyfoldingangle)
negative_4 = Negative(Value=valleyfoldingangle_4)
valleyfoldingstrength_num_5 = Number(valleyfoldingstrength_num_2)
radians_4 = Radians(Degrees=negative_4)
center_pt_10 = Point(center_pt)
hinge_4 = Hinge(
    FoldStart=center_pt_10,
    FoldEnd=valleypoint2_pt_8,
    Tip1=valleypoint1_pt_8,
    Tip2=mountainpoint1_pt_8,
    RestAngle=radians_4,
    Strength=valleyfoldingstrength_num_5)

# ----
mountainfolds_ln_3 = Line(mountainfolds_ln)
valleyfolds_ln_3 = Line(valleyfolds_ln)
sfwb_mesh_3 = Mesh(sfwb_mesh)
show = Show(G=mountainfolds_ln_3)
show_2 = Show(G=valleyfolds_ln_3)
show_3 = Show(G=sfwb_mesh_3)
mountain_col_3 = Colour(mountain_col)
valley_col_3 = Colour(valley_col)

# ---- group: Pouch
connectors_num_4 = Number(connectors_num_2)
center_pt_11 = Point(center_pt)
cluster_3 = Cluster_2(
    center_pt=center_pt_11,
    radiusouter_num=radiusouter_num_2,
    radiusinner_num=radiusinner_num_2,
    initialinflation_num=initialinflation_num_2,
    radiusmeshsize_num=radiusmeshsize_num,
    circlemeshsize_num=circlemeshsize_num,
    pressure_num=pressure_num,
    connectors_num=connectors_num_4)  # -> connectors_points_2, mesh_1_2, mesh_2, goal_mesh_1, goal_mesh_2
reset_bool_3 = Boolean(reset_bool)
list_length = ListLength(List=[cluster_3.goal_mesh_1, cluster_3.goal_mesh_2])  # -> flatten(Length)

# ----
data_dam = DataDam(DataA=[cluster_3.goal_mesh_1, cluster_3.goal_mesh_2], BufferDelay=10000000, BufferMode=0)

# ---- group: Geometry of SFWB / SFWB Edges
mountainpoint2_pt_9 = Point(mountainpoint2_pt)
mountainpoint1_pt_9 = Point(mountainpoint1_pt)
valleypoint2_pt_9 = Point(valleypoint2_pt)
valleypoint1_pt_9 = Point(valleypoint1_pt)
shift_list_3 = ShiftList(List=mountainpoint2_pt_9, Shift=1, Wrap=True)
line_3 = Line(StartPoint=mountainpoint1_pt_9, EndPoint=valleypoint2_pt_9)
line_4 = Line(StartPoint=valleypoint1_pt_9, EndPoint=shift_list_3)
mountainvalleyedges_ln = Line(line_3)
valleymountainedges_ln = Line(line_4)
mountainvalleyedges_ln_2 = Line(mountainvalleyedges_ln)
valleymountainedges_ln_2 = Line(valleymountainedges_ln)

# ---- group: Geometry of SFWB / Mountain Edges
line_5 = Line(StartPoint=mountainpoint2_pt_9, EndPoint=mountainpoint1_pt_9)

# ---- group: Geometry of SFWB / Valley Edges
line_6 = Line(StartPoint=valleypoint2_pt_9, EndPoint=valleypoint1_pt_9)

# ---- group: Geometry of SFWB / SFWB Edges (continued)
mountainedges_ln = Line(line_5)
valleyedges_ln = Line(line_6)
mountainedges_ln_2 = Line(mountainedges_ln)
valleyedges_ln_2 = Line(valleyedges_ln)

# ---- group: Geometry of SFWB / SFWB Connector Points
mountainedges_ln_3 = Line(mountainedges_ln)
curve_middle = CurveMiddle(Curve=mountainedges_ln_3)
sfwbconnector_pt = Point(curve_middle)
sfwbconnector_pt_2 = Point(sfwbconnector_pt)

# ----
sfwb_connector_point = Point(sfwbconnector_pt)
anchor = Anchor(Point=cluster_3.connectors_points_2, Target=sfwb_connector_point, Strength=10000)
mountainedges_ln_4 = Line(mountainedges_ln)
valleyedges_ln_3 = Line(valleyedges_ln)

# ---- group: Pouch (continued)
solver = Solver(
    GoalObjects=[cluster_3.goal_mesh_1, cluster_3.goal_mesh_2, anchor],
    Reset=reset_bool_3,
    Threshold=1e-15,
    Tolerance=0.0001,
    On=on_off_pouch)  # -> I, V, O
partition_list = PartitionList(List=solver.O, Size=list_length)
explode_tree = ExplodeTree(Data=partition_list)  # -> Branch0, Branch1, Branch2, Branch3, Branch4
mesh_join = MeshJoin(Meshes=explode_tree.Branch0)

# ----
oncurve = OnCurve(Points=cluster_3.connectors_points_2, Curve=[mountainedges_ln_4, valleyedges_ln_3], Strength=100)

# ---- group: Kangaroo Goals / Edge & Crease Length Fixed
mountainvalleyedges_ln_3 = Line(mountainvalleyedges_ln)
valleymountainedges_ln_3 = Line(valleymountainedges_ln)
mountainedges_ln_5 = Line(mountainedges_ln)
mountainfolds_ln_4 = Line(mountainfolds_ln)
valleyedges_ln_4 = Line(valleyedges_ln)
valleyfolds_ln_4 = Line(valleyfolds_ln)
length = Length(Curve=[mountainfolds_ln_4, valleyfolds_ln_4, mountainedges_ln_5, valleyedges_ln_4, mountainvalleyedges_ln_3, valleymountainedges_ln_3])
length_line = LengthLine(
    Line=[mountainfolds_ln_4, valleyfolds_ln_4, mountainedges_ln_5, valleyedges_ln_4, mountainvalleyedges_ln_3, valleymountainedges_ln_3],
    Length=length,
    Strength=10)  # -> flatten(Spring)

# ----
sfwbconnector_pt_3 = Point(sfwbconnector_pt)
mountainedges_ln_6 = Line(mountainedges_ln)
oncurve_2 = OnCurve(Points=sfwbconnector_pt_3, Curve=mountainedges_ln_6, Strength=1)

entwine = Entwine(
    Branch00=show,
    Branch01=show_2,
    Branch02=show_3,
    Branch03=[length_line, onplane, load, hinge_3, hinge_4, hinge_2, hinge],
    Branch04=oncurve_2,
    FlattenInputs=True)  # -> simplify(Result)

on_off_bool_3 = Boolean(on_off_bool)
reset_bool_4 = Boolean(reset_bool)
solver_2 = Solver(GoalObjects=entwine, Reset=reset_bool_4, Threshold=1e-15, Tolerance=0.01, On=on_off_bool_3)  # -> I, V, O

list_length_2 = ListLength(List=entwine)  # -> flatten(Length)
partition_list_2 = PartitionList(List=flatten(solver_2.O), Size=list_length_2)
explode_tree_2 = ExplodeTree(Data=partition_list_2)  # -> Branch0, Branch1, Branch2, Branch3, Branch4
mountain = Line(explode_tree_2.Branch0)

# ---- group: Valley
line_7 = Line(explode_tree_2.Branch1)

# ----
mesh = Mesh(explode_tree_2.Branch2)
point = Point(explode_tree_2.Branch4)

# ---- group: Crease
line_8 = Line(explode_tree_2.Branch3)

# ----
custom_preview = CustomPreview(Geometry=mountain, Material=mountain_col_3)
custom_preview_2 = CustomPreview(Geometry=line_7, Material=valley_col_3)

# ==== cluster Cluster
geometry = ClusterInput()
degrees = ClusterInput()

# ---- group: Split Fold
radians = Radians(Degrees=degrees)
division = Division(A=radians, B="2")
negative = Negative(Value=division)
rotate = Rotate(Geometry=geometry, Angle=division, Plane=PlaneXY(0, 0, 0))  # -> Geometry1, Transform
rotate_2 = Rotate(Geometry=geometry, Angle=negative, Plane=PlaneXY(0, 0, 0))  # -> Geometry2, Transform

# ----
geometry_2 = ClusterOutput(rotate_2.Geometry2)
geometry1 = ClusterOutput(rotate.Geometry1)

# ==== cluster Cluster_2
connectors_num = ClusterInput()
radiusmeshsize_num = ClusterInput()
circlemeshsize_num = ClusterInput()
initialinflation_num = ClusterInput()
radiusouter_num = ClusterInput()
radiusinner_num = ClusterInput()
pressure_num = ClusterInput()
center_pt = ClusterInput()
radiusmeshsize_num_2 = Number(radiusmeshsize_num)
circlemeshsize_num_2 = Number(circlemeshsize_num)
initialinflation_num_2 = Number(initialinflation_num)
radiusouter_num_2 = Number(radiusouter_num)
radiusinner_num_2 = Number(radiusinner_num)
connectors_num_2 = Number(connectors_num)
pressure_num_2 = Number(pressure_num)
center_pt_2 = Point(center_pt)
unit_z = UnitZ(Factor=initialinflation_num_2)
radiusouter_num_3 = Number(radiusouter_num_2)
radiusinner_num_3 = Number(radiusinner_num_2)
radiusinner_num_4 = Number(radiusinner_num_2)
radiusouter_num_4 = Number(radiusouter_num_2)
center_pt_3 = Point(center_pt_2)

radiusouter_num_5 = Number(radiusouter_num_2)
center_pt_4 = Point(center_pt_2)
circle_cnr = CircleCNR(Center=center_pt_4, Normal=Vector(0, 0, 1), Radius=radiusouter_num_5)

average = Average(Input=[radiusouter_num_4, radiusinner_num_4])
move = Move(Geometry=center_pt_3, Motion=unit_z)  # -> Geometry, Transform
expression = Expression(x=radiusouter_num_3, y=radiusinner_num_3, Expression="x-(x-y)/5")
center_pt_5 = Point(center_pt_2)

radiusinner_num_5 = Number(radiusinner_num_2)
circle_cnr_2 = CircleCNR(Center=center_pt_5, Normal=Vector(0, 0, 1), Radius=radiusinner_num_5)

circle = Circle(Plane=move.Geometry, Radius=expression)
circle_2 = Circle(Plane=move.Geometry, Radius=average)
innercircle_crv = Curve(circle_cnr_2)
outercircle_crv = Curve(circle_cnr)
innercircle_crv_2 = Curve(innercircle_crv)
outercircle_crv_2 = Curve(outercircle_crv)
connectors_num_3 = Number(connectors_num_2)
loft = Loft(
    Curves=[circle, circle_cnr],
    Options={Adjust=False, Closed=False, LoftEnds=0, LoftSimp=0, LoftType=0, Rebuild=10, Refit=0.01})
loft_2 = Loft(
    Curves=[circle_cnr_2, circle_2, circle],
    Options={Adjust=False, Closed=False, LoftEnds=0, LoftSimp=0, LoftType=0, Rebuild=10, Refit=0.01})
outercircle_crv_3 = Curve(outercircle_crv)
circlemeshsize_num_3 = Number(circlemeshsize_num_2)
radiusmeshsize_num_3 = Number(radiusmeshsize_num_2)
radiusmeshsize_num_4 = Number(radiusmeshsize_num_2)
circlemeshsize_num_4 = Number(circlemeshsize_num_2)
divide_curve = DivideCurve(Curve=outercircle_crv_3, Count=connectors_num_3, Kinks=False)  # -> Points, Tangents, Parameters
mesh_surface = MeshSurface(Surface=loft_2, UCount=circlemeshsize_num_3, VCount=radiusmeshsize_num_3, Overhang=False, Equalize=False)
mesh_surface_2 = MeshSurface(Surface=loft, UCount=circlemeshsize_num_4, VCount=expr("x*2", radiusmeshsize_num_4), Overhang=False, Equalize=False)
connectors_points = Point(divide_curve.Points)
mesh_join = MeshJoin(Meshes=[mesh_surface, mesh_surface_2])
mesh_1 = Mesh(mesh_join)

center_pt_6 = Point(center_pt_4)
xy_plane = XYPlane(Origin=center_pt_6)
mirror = Mirror(Geometry=mesh_1, Plane=xy_plane)  # -> Geometry, Transform

pressure_num_3 = Number(pressure_num_2)
pressure = Pressure(M=mirror.Geometry, Strength=pressure_num_3)

nakedvertices = NakedVertices(Mesh=mirror.Geometry)  # -> ClothedIndex, NakedIndex, ClothedPts, NakedPts
edgelengths = EdgeLengths(Mesh=mirror.Geometry, LengthFactor=1, Strength=100)

pressure_num_4 = Number(pressure_num_2)
pressure_2 = Pressure(M=mesh_1, Strength=pressure_num_4)

show = Show(G=mirror.Geometry)
nakedvertices_2 = NakedVertices(Mesh=mesh_1)  # -> ClothedIndex, NakedIndex, ClothedPts, NakedPts
edgelengths_2 = EdgeLengths(Mesh=mesh_1, LengthFactor=1, Strength=100)
show_2 = Show(G=mesh_1)

outercircle_crv_4 = Curve(outercircle_crv)
innercircle_crv_3 = Curve(innercircle_crv)
point_in_curve = PointInCurve(Point=nakedvertices.NakedPts, Curve=outercircle_crv_4)  # -> Relationship, Point
point_in_curve_2 = PointInCurve(Point=nakedvertices.NakedPts, Curve=innercircle_crv_3)  # -> Relationship, Point
equality = Equality(FirstNumber=point_in_curve.Relationship, SecondNumber=1)  # -> Equality, Inequality
equality_2 = Equality(FirstNumber=point_in_curve_2.Relationship, SecondNumber=1)  # -> Equality, Inequality
cull_pattern = CullPattern(List=point_in_curve_2.Point, CullPattern=equality_2.Equality)
cull_pattern_2 = CullPattern(List=point_in_curve.Point, CullPattern=equality.Equality)
point = Point([cull_pattern_2, cull_pattern])

outercircle_crv_5 = Curve(outercircle_crv)
innercircle_crv_4 = Curve(innercircle_crv)
point_in_curve_3 = PointInCurve(Point=nakedvertices_2.NakedPts, Curve=outercircle_crv_5)  # -> Relationship, Point
point_in_curve_4 = PointInCurve(Point=nakedvertices_2.NakedPts, Curve=innercircle_crv_4)  # -> Relationship, Point
equality_3 = Equality(FirstNumber=point_in_curve_3.Relationship, SecondNumber=1)  # -> Equality, Inequality
equality_4 = Equality(FirstNumber=point_in_curve_4.Relationship, SecondNumber=1)  # -> Equality, Inequality
cull_pattern_3 = CullPattern(List=point_in_curve_4.Point, CullPattern=equality_4.Equality)
cull_pattern_4 = CullPattern(List=point_in_curve_3.Point, CullPattern=equality_3.Equality)
point_2 = Point([cull_pattern_4, cull_pattern_3])

center_pt_7 = Point(center_pt_4)
onplane = OnPlane(Points=point_2, Plane=center_pt_7, Strength=100)

center_pt_8 = Point(center_pt_4)
onplane_2 = OnPlane(Points=point, Plane=center_pt_8, Strength=100)

merge = Merge(Data1=show_2, Data2=[onplane, pressure_2, edgelengths_2])
merge_2 = Merge(Data1=show, Data2=[edgelengths, onplane_2, pressure])
connectors_points_2 = ClusterOutput(connectors_points)
goal_mesh_1 = ClusterOutput(merge)
goal_mesh_2 = ClusterOutput(merge_2)
mesh_1_2 = ClusterOutput(mesh_1)
mesh_2 = ClusterOutput(mirror.Geometry)
