# Grasshopper definition WB.gh (Grasshopper 1.0.7)
# plug-ins: Kangaroo2 Components

mountain_fold_strength = Slider(1, range=0..10)
vertical_load = Slider(1.88, range=-6..6)
folding_angle = Slider(45, range=0..150)
n_num = Slider(10, range=3..20)
radius = Slider(10, range=5..15)
xy_plane = XYPlane(Origin=Point(0, 0, 0))
construct_point = ConstructPoint(XCoordinate=0, YCoordinate=0, ZCoordinate=0)
on_off_solver = BooleanToggle(True)
reset = Button()
number_slider = Slider(0, range=0..1000)
mountain_col = Colour(ColourSwatch(SwatchColor=RGB(255, 0, 0)))
on_off_bool = Boolean(on_off_solver)
reset_bool = Boolean(reset)
radius_num = Number(radius)
ground_pln = Plane(xy_plane)
n_num_2 = Integer(n_num)
valley_col = Colour(ColourSwatch(SwatchColor=RGB(31, 2, 250)))
center_pt = Point(construct_point)
foldangle_int = Integer(folding_angle)
verticalload_num = Number(vertical_load)
mountain_fold_strength_2 = Number(mountain_fold_strength)
mountain_col_2 = Colour(mountain_col)
radius_num_2 = Number(radius_num)
ground_pln_2 = Plane(ground_pln)
n_num_3 = Integer(n_num)
valley_col_2 = Colour(valley_col)
on_off_bool_2 = Boolean(on_off_bool)
center_pt_2 = Point(center_pt)
reset_bool_2 = Boolean(reset_bool)
foldangle_int_2 = Integer(foldangle_int)
verticalload_num_2 = Number(verticalload_num)
mountain_fold_strength_3 = Number(mountain_fold_strength_2)
radius_num_3 = Number(radius_num)
ground_pln_3 = Plane(ground_pln)
center_pt_3 = Point(center_pt)
circle = Circle(Plane=ground_pln_3, Radius=radius_num_3)

# ---- group: Mountain
n_num_4 = Integer(n_num)
divide_curve = DivideCurve(Curve=circle, Count=n_num_4, Kinks=False)  # -> flatten(Points), Tangents, Parameters

# ---- group: Valley
pi = Pi(Factor=1)
n_num_5 = Integer(n_num)
division = Division(A=pi, B=n_num_5)
rotate = Rotate(Geometry=divide_curve.Points, Angle=division, Plane=PlaneXY(0, 0, 0))  # -> flatten(Geometry), Transform

# ----
delaunay_mesh = DelaunayMesh(Points=[divide_curve.Points, rotate.Geometry, center_pt_3], Plane=PlaneXY(0, 0, 0))

# ---- group: Edges
shift_list = ShiftList(List=divide_curve.Points, Shift=1, Wrap=True)
line = Line(StartPoint=rotate.Geometry, EndPoint=shift_list)
line_2 = Line(StartPoint=divide_curve.Points, EndPoint=rotate.Geometry)

# ---- group: Mountain Fold
center_pt_4 = Point(center_pt)
line_3 = Line(StartPoint=center_pt_4, EndPoint=divide_curve.Points)

# ---- group: Valley Fold
center_pt_5 = Point(center_pt)
line_4 = Line(StartPoint=center_pt_5, EndPoint=rotate.Geometry)

# ----
coplanar = CoPlanar(Points=divide_curve.Points, Strength=1)
coplanar_2 = CoPlanar(Points=rotate.Geometry, Strength=1)
stream_filter = StreamFilter(Gate=Toggle(True), Stream0=divide_curve.Points, Stream1=rotate.Geometry)
show = Show(G=delaunay_mesh)

length = Length(Curve=[line_3, line_4, line_2, line])
length_line = LengthLine(Line=[line_3, line_4, line_2, line], Length=length, Strength=10)

ground_pln_4 = Plane(ground_pln)

foldangle_int_3 = Integer(foldangle_int)
shift_list_2 = ShiftList(List=divide_curve.Points, Shift=1, Wrap=True)
mountain_fold_strength_4 = Number(mountain_fold_strength_2)
radians = Radians(Degrees=foldangle_int_3)
center_pt_6 = Point(center_pt)
hinge = Hinge(
    FoldStart=center_pt_6,
    FoldEnd=rotate.Geometry,
    Tip1=divide_curve.Points,
    Tip2=shift_list_2,
    RestAngle=radians,
    Strength=mountain_fold_strength_4)

unit_z = UnitZ(Factor=1)
verticalload_num_3 = Number(verticalload_num)
center_pt_7 = Point(center_pt)
load = Load(Point=center_pt_7, ForceVector=unit_z, Weighting=verticalload_num_3)

show_2 = Show(G=line_3)
show_3 = Show(G=line_4)
onplane = OnPlane(Points=stream_filter, Plane=ground_pln_4, Strength="1000")
entwine = Entwine(
    Branch00=show_2,
    Branch01=show_3,
    Branch02=show,
    Branch03=[hinge, length_line, coplanar, coplanar_2, onplane, load],
    FlattenInputs=True)  # -> simplify(Result)
list_length = ListLength(List=entwine)  # -> flatten(Length)
on_off_bool_3 = Boolean(on_off_bool)
reset_bool_3 = Boolean(reset_bool)
solver = Solver(GoalObjects=entwine, Reset=reset_bool_3, Threshold=1e-15, Tolerance=0.01, On=on_off_bool_3)  # -> I, V, O
partition_list = PartitionList(List=flatten(solver.O), Size=list_length)
explode_tree = ExplodeTree(Data=partition_list)  # -> Branch0, Branch1, Branch2, Branch3
mesh = Mesh(explode_tree.Branch2)
mountain = Line(explode_tree.Branch0)

# ---- group: Valley
line_5 = Line(explode_tree.Branch1)

# ---- group: Crease
line_6 = Line(explode_tree.Branch3)

# ----
mountain_col_3 = Colour(mountain_col)
valley_col_3 = Colour(valley_col)
custom_preview = CustomPreview(Geometry=mountain, Material=mountain_col_3)
custom_preview_2 = CustomPreview(Geometry=line_5, Material=valley_col_3)
